% Simulink data dictionary fixedWingPathFollowingData.sldd

FixedWingEnvironmentBus = Simulink.Bus()
  WindNorth: double
  WindEast: double
  WindDown: double
  Gravity: double

ctrlConfigSet = Simulink.ConfigSet(StartTime="0", StopTime="TFinal", RelTol="1e-4", Solver="VariableStepAuto", ProdHWDeviceType="Generic->Unspecified (assume 32-bit Generic)", SystemTargetFile="grt.tlc", TargetLang="C")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
plantConfigSet = Simulink.ConfigSet(StartTime="0", StopTime="TFinal", RelTol="1e-3", Solver="VariableStepAuto", ProdHWDeviceType="Generic->32-bit x86 compatible", SystemTargetFile="grt.tlc", TargetLang="C")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

FixedWingControlBus = Simulink.Bus()
  Height: double
  AirSpeed: double
  RollAngle: double

FixedWingControlBus2 = Simulink.Bus()
  Pitch_Ref: double
  Roll_Ref: double

ctrlCmdsBus = Simulink.Bus()
  elevator: double
  aileron: double
  aileronTrim: double

ConfigureStatus = Simulink.Bus()
  x_final: double
  y_final: double
  z_final: double
  V_final: double
  FlightPathAngle_final: double
  HeadingAngle_final: double
  SideslipAngle_final: double
  x_turnoff: double
  y_turnoff: double
  z_turnoff: double
  HeadingAngle_turnoff: double

FixedWingStateBus = Simulink.Bus()
  North: double
  East: double
  Height: double
  AirSpeed: double
  HeadingAngle: double
  FlightPathAngle: double
  RollAngle: double
  RollAngleRate: double